# Grasshopper definition Ex_1_OSM3DBuildings.gh (Grasshopper 0.9.76)
# plug-ins: atit, HDTReference

addressparser = GeoCoderAddressParser(SearchAdress="union square nyc")  # -> Formatted_Adress, Location
nickname = Osm_bldgs(Location=addressparser.Location, X_Range=100, Y_Range=100)  # -> Osm_3D_Bldgs, Osm_IDs, BuildingsColors
panel = Panel(nickname.Osm_3D_Bldgs)

# ---- group: Better Visualization
number_slider = Slider(10, range=0..10)
wires = BrepWireframe(Brep=nickname.Osm_3D_Bldgs, Density=-1)
ext = ExtendCurve(Curve=wires, Type=0, Start=number_slider, End=number_slider)
preview = CustomPreview(Geometry=nickname.Osm_3D_Bldgs, Shader=ColourSwatch(SwatchColor=RGB(206, 224, 255)))
previewlw = CustomPreviewLineweights(Geometry=wires, Shader=ColourSwatch(SwatchColor=RGB(0, 0, 0)), Thickness=Slider(1, range=0..10))
